% Requirement links of CruiseControl_TestSuite.slx (R2022b)

block :26 implements CruiseControl_TestSuite.slreqx#2: Enable/Disable Switch
block :27 implements CruiseControl_TestSuite.slreqx#6: Vehicle Brake Input
block :28 implements CruiseControl_TestSuite.slreqx#3: Set Speed/Decelerate Button
block :29 implements CruiseControl_TestSuite.slreqx#5: Vehicle Speed Input
block :30 implements CruiseControl_TestSuite.slreqx#4: Resume Speed/Accelerate Button
block :46 implements CruiseControl_TestSuite.slreqx#9: Target Speed Output
block :47 implements CruiseControl_TestSuite.slreqx#8: Engaged (active) Output
block :7:105 implements CruiseControl_TestSuite.slreqx#17: Initial transition from disengaged (inactive) to engaged (active) only with “Set Speed” input after enabling (on)
block :7:105 implements CruiseControl_TestSuite.slreqx#18: “Resume” input ignored until the initial transition from disengaged (inactive) to engaged (active)
block :7:105 implements CruiseControl_TestSuite.slreqx#20: Subsequent transition from disengaged (inactive) to engaged (active) with “Resume” input while enabled (on)
block :7:107 implements CruiseControl_TestSuite.slreqx#17: Initial transition from disengaged (inactive) to engaged (active) only with “Set Speed” input after enabling (on)
block :7:107 implements CruiseControl_TestSuite.slreqx#19: Subsequent transition from disengaged (inactive) to engaged (active) with “Set Speed” input while enabled (on)
block :7:47 implements CruiseControl_TestSuite.slreqx#14: Disabled (off) during start-up
block :7:47 implements CruiseControl_TestSuite.slreqx#16: Disengaged (not active) when disabled (off)
block :7:50 implements CruiseControl_TestSuite.slreqx#16: Disengaged (not active) when disabled (off)
block :7:52 implements CruiseControl_TestSuite.slreqx#15: Not engaged with enabling (on)
block :7:53 implements CruiseControl_TestSuite.slreqx#15: Not engaged with enabling (on)
block :7:54 implements CruiseControl_TestSuite.slreqx#17
block :7:55 implements CruiseControl_TestSuite.slreqx#26: Vehicle braking will transition system to disengaged (inactive) when engaged (active)
block :7:55 implements CruiseControl_TestSuite.slreqx#28: Transition to disengaged (inactive) when vehicle speed is outside the limits of 20 to 90 mph
block :7:55 implements CruiseControl_TestSuite.slreqx#29: Target speed will be limited between 20 and 90 mph
block :7:55 implements CruiseControl_TestSuite.slreqx#34: Disengage when braking occurs
block :7:56 implements CruiseControl_TestSuite.slreqx#21: “Accelerate” input increases target speed only when engaged (active)
block :7:56 implements CruiseControl_TestSuite.slreqx#23: Continuous “Accelerate” input increases target speed at a fixed rate and only when engaged (active)
block :7:58 implements CruiseControl_TestSuite.slreqx#23: Continuous “Accelerate” input increases target speed at a fixed rate and only when engaged (active)
block :7:61 implements CruiseControl_TestSuite.slreqx#23: Continuous “Accelerate” input increases target speed at a fixed rate and only when engaged (active)
block :7:62 implements CruiseControl_TestSuite.slreqx#23: Continuous “Accelerate” input increases target speed at a fixed rate and only when engaged (active)
block :7:64 implements CruiseControl_TestSuite.slreqx#27: Transition to engaged (active) will only be permitted for vehicle speeds between 20 and 90 mph
block :7:64 implements CruiseControl_TestSuite.slreqx#29: Target speed will be limited between 20 and 90 mph
block :7:65 implements CruiseControl_TestSuite.slreqx#29: Target speed will be limited between 20 and 90 mph
block :7:66 implements CruiseControl_TestSuite.slreqx#21: “Accelerate” input increases target speed only when engaged (active)
block :7:66 implements CruiseControl_TestSuite.slreqx#29: Target speed will be limited between 20 and 90 mph
block :7:67 implements CruiseControl_TestSuite.slreqx#22: “Decelerate” input decreases target speed only when engaged (active)
block :7:67 implements CruiseControl_TestSuite.slreqx#29: Target speed will be limited between 20 and 90 mph
block :7:68 implements CruiseControl_TestSuite.slreqx#24: Continuous “Decelerate” input decreases target speed at a fixed rate and only when engaged (active)
block :7:69 implements CruiseControl_TestSuite.slreqx#24: Continuous “Decelerate” input decreases target speed at a fixed rate and only when engaged (active)
block :7:70 implements CruiseControl_TestSuite.slreqx#24: Continuous “Decelerate” input decreases target speed at a fixed rate and only when engaged (active)
block :7:73 implements CruiseControl_TestSuite.slreqx#22: “Decelerate” input decreases target speed only when engaged (active)
block :7:73 implements CruiseControl_TestSuite.slreqx#24: Continuous “Decelerate” input decreases target speed at a fixed rate and only when engaged (active)
block :7:74 implements CruiseControl_TestSuite.slreqx#29: Target speed will be limited between 20 and 90 mph
block :7:78 implements CruiseControl_TestSuite.slreqx#17: Initial transition from disengaged (inactive) to engaged (active) only with “Set Speed” input after enabling (on)
block :7:79 implements CruiseControl_TestSuite.slreqx#17: Initial transition from disengaged (inactive) to engaged (active) only with “Set Speed” input after enabling (on)
block :7:80 implements CruiseControl_TestSuite.slreqx#17: Initial transition from disengaged (inactive) to engaged (active) only with “Set Speed” input after enabling (on)
block :7:81 implements CruiseControl_TestSuite.slreqx#17: Initial transition from disengaged (inactive) to engaged (active) only with “Set Speed” input after enabling (on)
block :7:82 implements CruiseControl_TestSuite.slreqx#14: Disabled (off) during start-up