% Requirement links of CruiseControl_TestSuite.mldatx (R2024a)

item 1 verifies CruiseControl_TestSuite.slreqx#16: Disengaged (not active) when disabled (off)
item 2 verifies CruiseControl_TestSuite.slreqx#24: Continuous “Decelerate” input decreases target speed at a fixed rate and only when engaged (active)
item 3 verifies CruiseControl_TestSuite.slreqx#23: Continuous “Accelerate” input increases target speed at a fixed rate and only when engaged (active)
item 4 verifies CruiseControl_TestSuite.slreqx#24: Continuous “Decelerate” input decreases target speed at a fixed rate and only when engaged (active)
item 5 verifies CruiseControl_TestSuite.slreqx#24: Continuous “Decelerate” input decreases target speed at a fixed rate and only when engaged (active)
item 6 verifies CruiseControl_TestSuite.slreqx#14: Disabled (off) during start-up
item 7 verifies CruiseControl_TestSuite.slreqx#19: Subsequent transition from disengaged (inactive) to engaged (active) with “Set Speed” input while enabled (on)
item 7 verifies CruiseControl_TestSuite.slreqx#20: Subsequent transition from disengaged (inactive) to engaged (active) with “Resume” input while enabled (on)
item 8 verifies CruiseControl_TestSuite.slreqx#27: Transition to engaged (active) will only be permitted for vehicle speeds between 20 and 90 mph
item 8 verifies CruiseControl_TestSuite.slreqx#29: Target speed will be limited between 20 and 90 mph
item 9 verifies CruiseControl_TestSuite.slreqx#21: “Accelerate” input increases target speed only when engaged (active)
item 10 verifies CruiseControl_TestSuite.slreqx#14: Disabled (off) during start-up
item 11 verifies CruiseControl_TestSuite.slreqx#16: Disengaged (not active) when disabled (off)
item 12 verifies CruiseControl_TestSuite.slreqx#22: “Decelerate” input decreases target speed only when engaged (active)
item 13 verifies CruiseControl_TestSuite.slreqx#23: Continuous “Accelerate” input increases target speed at a fixed rate and only when engaged (active)
item 14 verifies CruiseControl_TestSuite.slreqx#22: “Decelerate” input decreases target speed only when engaged (active)
item 15 verifies CruiseControl_TestSuite.slreqx#24: Continuous “Decelerate” input decreases target speed at a fixed rate and only when engaged (active)
item 16 verifies CruiseControl_TestSuite.slreqx#15: Not engaged with enabling (on)
item 17 verifies CruiseControl_TestSuite.slreqx#26: Vehicle braking will transition system to disengaged (inactive) when engaged (active)
item 17 verifies CruiseControl_TestSuite.slreqx#34: Disengage when braking occurs
item 18 verifies CruiseControl_TestSuite.slreqx#21: “Accelerate” input increases target speed only when engaged (active)
item 19 verifies CruiseControl_TestSuite.slreqx#27: Transition to engaged (active) will only be permitted for vehicle speeds between 20 and 90 mph
item 19 verifies CruiseControl_TestSuite.slreqx#29: Target speed will be limited between 20 and 90 mph
item 20 verifies CruiseControl_TestSuite.slreqx#16: Disengaged (not active) when disabled (off)
item 21 verifies CruiseControl_TestSuite.slreqx#26: Vehicle braking will transition system to disengaged (inactive) when engaged (active)
item 21 verifies CruiseControl_TestSuite.slreqx#34: Disengage when braking occurs
item 22 verifies CruiseControl_TestSuite.slreqx#17: Initial transition from disengaged (inactive) to engaged (active) only with “Set Speed” input after enabling (on)
item 23 verifies CruiseControl_TestSuite.slreqx#14: Disabled (off) during start-up
item 24 verifies CruiseControl_TestSuite.slreqx#23: Continuous “Accelerate” input increases target speed at a fixed rate and only when engaged (active)
item 25 verifies CruiseControl_TestSuite.slreqx#28: Transition to disengaged (inactive) when vehicle speed is outside the limits of 20 to 90 mph
item 25 verifies CruiseControl_TestSuite.slreqx#29: Target speed will be limited between 20 and 90 mph
item 26 verifies CruiseControl_TestSuite.slreqx#19: Subsequent transition from disengaged (inactive) to engaged (active) with “Set Speed” input while enabled (on)
item 26 verifies CruiseControl_TestSuite.slreqx#20: Subsequent transition from disengaged (inactive) to engaged (active) with “Resume” input while enabled (on)
item 27 verifies CruiseControl_TestSuite.slreqx#22: “Decelerate” input decreases target speed only when engaged (active)
item 28 verifies CruiseControl_TestSuite.slreqx#24: Continuous “Decelerate” input decreases target speed at a fixed rate and only when engaged (active)
item 29 verifies CruiseControl_TestSuite.slreqx#19: Subsequent transition from disengaged (inactive) to engaged (active) with “Set Speed” input while enabled (on)
item 29 verifies CruiseControl_TestSuite.slreqx#20: Subsequent transition from disengaged (inactive) to engaged (active) with “Resume” input while enabled (on)
item 30 verifies CruiseControl_TestSuite.slreqx#18: “Resume” input ignored until the initial transition from disengaged (inactive) to engaged (active)
item 31 verifies CruiseControl_TestSuite.slreqx#19: Subsequent transition from disengaged (inactive) to engaged (active) with “Set Speed” input while enabled (on)
item 31 verifies CruiseControl_TestSuite.slreqx#20: Subsequent transition from disengaged (inactive) to engaged (active) with “Resume” input while enabled (on)
item 32 verifies CruiseControl_TestSuite.slreqx#18: “Resume” input ignored until the initial transition from disengaged (inactive) to engaged (active)
item 33 verifies CruiseControl_TestSuite.slreqx#17: Initial transition from disengaged (inactive) to engaged (active) only with “Set Speed” input after enabling (on)
item 34 verifies CruiseControl_TestSuite.slreqx#17: Initial transition from disengaged (inactive) to engaged (active) only with “Set Speed” input after enabling (on)
item 35 verifies CruiseControl_TestSuite.slreqx#18: “Resume” input ignored until the initial transition from disengaged (inactive) to engaged (active)
item 36 verifies CruiseControl_TestSuite.slreqx#22: “Decelerate” input decreases target speed only when engaged (active)
item 37 verifies CruiseControl_TestSuite.slreqx#26: Vehicle braking will transition system to disengaged (inactive) when engaged (active)
item 37 verifies CruiseControl_TestSuite.slreqx#34: Disengage when braking occurs
item 38 verifies CruiseControl_TestSuite.slreqx#22: “Decelerate” input decreases target speed only when engaged (active)
item 39 verifies CruiseControl_TestSuite.slreqx#18: “Resume” input ignored until the initial transition from disengaged (inactive) to engaged (active)
item 40 verifies CruiseControl_TestSuite.slreqx#26: Vehicle braking will transition system to disengaged (inactive) when engaged (active)
item 40 verifies CruiseControl_TestSuite.slreqx#34: Disengage when braking occurs
item 41 verifies CruiseControl_TestSuite.slreqx#18: “Resume” input ignored until the initial transition from disengaged (inactive) to engaged (active)
item 42 verifies CruiseControl_TestSuite.slreqx#21: “Accelerate” input increases target speed only when engaged (active)
item 43 verifies CruiseControl_TestSuite.slreqx#18: “Resume” input ignored until the initial transition from disengaged (inactive) to engaged (active)
item 44 verifies CruiseControl_TestSuite.slreqx#14: Disabled (off) during start-up
item 45 verifies CruiseControl_TestSuite.slreqx#26: Vehicle braking will transition system to disengaged (inactive) when engaged (active)
item 45 verifies CruiseControl_TestSuite.slreqx#34: Disengage when braking occurs
item 46 verifies CruiseControl_TestSuite.slreqx#28: Transition to disengaged (inactive) when vehicle speed is outside the limits of 20 to 90 mph
item 46 verifies CruiseControl_TestSuite.slreqx#29: Target speed will be limited between 20 and 90 mph
item 47 verifies CruiseControl_TestSuite.slreqx#23: Continuous “Accelerate” input increases target speed at a fixed rate and only when engaged (active)
item 48 verifies CruiseControl_TestSuite.slreqx#14: Disabled (off) during start-up
item 49 verifies CruiseControl_TestSuite.slreqx#27: Transition to engaged (active) will only be permitted for vehicle speeds between 20 and 90 mph
item 49 verifies CruiseControl_TestSuite.slreqx#29: Target speed will be limited between 20 and 90 mph
item 50 verifies CruiseControl_TestSuite.slreqx#23: Continuous “Accelerate” input increases target speed at a fixed rate and only when engaged (active)
item 51 verifies CruiseControl_TestSuite.slreqx#28: Transition to disengaged (inactive) when vehicle speed is outside the limits of 20 to 90 mph
item 51 verifies CruiseControl_TestSuite.slreqx#29: Target speed will be limited between 20 and 90 mph
item 52 verifies CruiseControl_TestSuite.slreqx#17: Initial transition from disengaged (inactive) to engaged (active) only with “Set Speed” input after enabling (on)
item 53 verifies CruiseControl_TestSuite.slreqx#15: Not engaged with enabling (on)
item 54 verifies CruiseControl_TestSuite.slreqx#18: “Resume” input ignored until the initial transition from disengaged (inactive) to engaged (active)
item 55 verifies CruiseControl_TestSuite.slreqx#16: Disengaged (not active) when disabled (off)
item 56 verifies CruiseControl_TestSuite.slreqx#22: “Decelerate” input decreases target speed only when engaged (active)
item 57 verifies CruiseControl_TestSuite.slreqx#17: Initial transition from disengaged (inactive) to engaged (active) only with “Set Speed” input after enabling (on)
item 58 verifies CruiseControl_TestSuite.slreqx#22: “Decelerate” input decreases target speed only when engaged (active)
item 59 verifies CruiseControl_TestSuite.slreqx#19: Subsequent transition from disengaged (inactive) to engaged (active) with “Set Speed” input while enabled (on)
item 59 verifies CruiseControl_TestSuite.slreqx#20: Subsequent transition from disengaged (inactive) to engaged (active) with “Resume” input while enabled (on)
item 60 verifies CruiseControl_TestSuite.slreqx#15: Not engaged with enabling (on)
item 61 verifies CruiseControl_TestSuite.slreqx#17: Initial transition from disengaged (inactive) to engaged (active) only with “Set Speed” input after enabling (on)
item 62 verifies CruiseControl_TestSuite.slreqx#19: Subsequent transition from disengaged (inactive) to engaged (active) with “Set Speed” input while enabled (on)
item 62 verifies CruiseControl_TestSuite.slreqx#20: Subsequent transition from disengaged (inactive) to engaged (active) with “Resume” input while enabled (on)
item 63 verifies CruiseControl_TestSuite.slreqx#23: Continuous “Accelerate” input increases target speed at a fixed rate and only when engaged (active)
item 64 verifies CruiseControl_TestSuite.slreqx#19: Subsequent transition from disengaged (inactive) to engaged (active) with “Set Speed” input while enabled (on)
item 64 verifies CruiseControl_TestSuite.slreqx#20: Subsequent transition from disengaged (inactive) to engaged (active) with “Resume” input while enabled (on)
item 65 verifies CruiseControl_TestSuite.slreqx#16: Disengaged (not active) when disabled (off)
item 66 verifies CruiseControl_TestSuite.slreqx#15: Not engaged with enabling (on)
item 67 verifies CruiseControl_TestSuite.slreqx#17: Initial transition from disengaged (inactive) to engaged (active) only with “Set Speed” input after enabling (on)
item 68 verifies CruiseControl_TestSuite.slreqx#14: Disabled (off) during start-up
item 69 verifies CruiseControl_TestSuite.slreqx#16: Disengaged (not active) when disabled (off)
item 70 verifies CruiseControl_TestSuite.slreqx#15: Not engaged with enabling (on)
item 71 verifies CruiseControl_TestSuite.slreqx#23: Continuous “Accelerate” input increases target speed at a fixed rate and only when engaged (active)
item 72 verifies CruiseControl_TestSuite.slreqx#22: “Decelerate” input decreases target speed only when engaged (active)
item 73 verifies CruiseControl_TestSuite.slreqx#15: Not engaged with enabling (on)
item 74 verifies CruiseControl_TestSuite.slreqx#14: Disabled (off) during start-up
item 75 verifies CruiseControl_TestSuite.slreqx#19: Subsequent transition from disengaged (inactive) to engaged (active) with “Set Speed” input while enabled (on)
item 75 verifies CruiseControl_TestSuite.slreqx#20: Subsequent transition from disengaged (inactive) to engaged (active) with “Resume” input while enabled (on)
item 76 verifies CruiseControl_TestSuite.slreqx#21: “Accelerate” input increases target speed only when engaged (active)
item 77 verifies CruiseControl_TestSuite.slreqx#18: “Resume” input ignored until the initial transition from disengaged (inactive) to engaged (active)
item 78 verifies CruiseControl_TestSuite.slreqx#28: Transition to disengaged (inactive) when vehicle speed is outside the limits of 20 to 90 mph
item 78 verifies CruiseControl_TestSuite.slreqx#29: Target speed will be limited between 20 and 90 mph
item 79 verifies CruiseControl_TestSuite.slreqx#21: “Accelerate” input increases target speed only when engaged (active)
item 80 verifies CruiseControl_TestSuite.slreqx#23: Continuous “Accelerate” input increases target speed at a fixed rate and only when engaged (active)
item 81 verifies CruiseControl_TestSuite.slreqx#21: “Accelerate” input increases target speed only when engaged (active)
item 82 verifies CruiseControl_TestSuite.slreqx#27: Transition to engaged (active) will only be permitted for vehicle speeds between 20 and 90 mph
item 82 verifies CruiseControl_TestSuite.slreqx#29: Target speed will be limited between 20 and 90 mph
item 83 verifies CruiseControl_TestSuite.slreqx#17: Initial transition from disengaged (inactive) to engaged (active) only with “Set Speed” input after enabling (on)
item 84 verifies CruiseControl_TestSuite.slreqx#27: Transition to engaged (active) will only be permitted for vehicle speeds between 20 and 90 mph
item 84 verifies CruiseControl_TestSuite.slreqx#29: Target speed will be limited between 20 and 90 mph
item 85 verifies CruiseControl_TestSuite.slreqx#27: Transition to engaged (active) will only be permitted for vehicle speeds between 20 and 90 mph
item 85 verifies CruiseControl_TestSuite.slreqx#29: Target speed will be limited between 20 and 90 mph
item 86 verifies CruiseControl_TestSuite.slreqx#19: Subsequent transition from disengaged (inactive) to engaged (active) with “Set Speed” input while enabled (on)
item 86 verifies CruiseControl_TestSuite.slreqx#20: Subsequent transition from disengaged (inactive) to engaged (active) with “Resume” input while enabled (on)
item 87 verifies CruiseControl_TestSuite.slreqx#16: Disengaged (not active) when disabled (off)
item 88 verifies CruiseControl_TestSuite.slreqx#24: Continuous “Decelerate” input decreases target speed at a fixed rate and only when engaged (active)
item 89 verifies CruiseControl_TestSuite.slreqx#23: Continuous “Accelerate” input increases target speed at a fixed rate and only when engaged (active)
item 90 verifies CruiseControl_TestSuite.slreqx#16: Disengaged (not active) when disabled (off)
item 91 verifies CruiseControl_TestSuite.slreqx#15: Not engaged with enabling (on)
item 92 verifies CruiseControl_TestSuite.slreqx#23: Continuous “Accelerate” input increases target speed at a fixed rate and only when engaged (active)
item 93 verifies CruiseControl_TestSuite.slreqx#19: Subsequent transition from disengaged (inactive) to engaged (active) with “Set Speed” input while enabled (on)
item 93 verifies CruiseControl_TestSuite.slreqx#20: Subsequent transition from disengaged (inactive) to engaged (active) with “Resume” input while enabled (on)
item 94 verifies CruiseControl_TestSuite.slreqx#27: Transition to engaged (active) will only be permitted for vehicle speeds between 20 and 90 mph
item 94 verifies CruiseControl_TestSuite.slreqx#29: Target speed will be limited between 20 and 90 mph
item 95 verifies CruiseControl_TestSuite.slreqx#18: “Resume” input ignored until the initial transition from disengaged (inactive) to engaged (active)
item 96 verifies CruiseControl_TestSuite.slreqx#24: Continuous “Decelerate” input decreases target speed at a fixed rate and only when engaged (active)
item 97 verifies CruiseControl_TestSuite.slreqx#24: Continuous “Decelerate” input decreases target speed at a fixed rate and only when engaged (active)
item 98 verifies CruiseControl_TestSuite.slreqx#21: “Accelerate” input increases target speed only when engaged (active)
item 99 verifies CruiseControl_TestSuite.slreqx#18: “Resume” input ignored until the initial transition from disengaged (inactive) to engaged (active)
item 100 verifies CruiseControl_TestSuite.slreqx#27: Transition to engaged (active) will only be permitted for vehicle speeds between 20 and 90 mph
item 100 verifies CruiseControl_TestSuite.slreqx#29: Target speed will be limited between 20 and 90 mph
item 101 verifies CruiseControl_TestSuite.slreqx#19: Subsequent transition from disengaged (inactive) to engaged (active) with “Set Speed” input while enabled (on)
item 101 verifies CruiseControl_TestSuite.slreqx#20: Subsequent transition from disengaged (inactive) to engaged (active) with “Resume” input while enabled (on)
item 102 verifies CruiseControl_TestSuite.slreqx#14: Disabled (off) during start-up
item 103 verifies CruiseControl_TestSuite.slreqx#21: “Accelerate” input increases target speed only when engaged (active)
item 104 verifies CruiseControl_TestSuite.slreqx#26: Vehicle braking will transition system to disengaged (inactive) when engaged (active)
item 104 verifies CruiseControl_TestSuite.slreqx#34: Disengage when braking occurs
item 105 verifies CruiseControl_TestSuite.slreqx#17: Initial transition from disengaged (inactive) to engaged (active) only with “Set Speed” input after enabling (on)
item 106 verifies CruiseControl_TestSuite.slreqx#27: Transition to engaged (active) will only be permitted for vehicle speeds between 20 and 90 mph
item 106 verifies CruiseControl_TestSuite.slreqx#29: Target speed will be limited between 20 and 90 mph
item 107 verifies CruiseControl_TestSuite.slreqx#27: Transition to engaged (active) will only be permitted for vehicle speeds between 20 and 90 mph
item 107 verifies CruiseControl_TestSuite.slreqx#29: Target speed will be limited between 20 and 90 mph
item 108 verifies CruiseControl_TestSuite.slreqx#27: Transition to engaged (active) will only be permitted for vehicle speeds between 20 and 90 mph
item 108 verifies CruiseControl_TestSuite.slreqx#29: Target speed will be limited between 20 and 90 mph
item 109 verifies CruiseControl_TestSuite.slreqx#28: Transition to disengaged (inactive) when vehicle speed is outside the limits of 20 to 90 mph
item 109 verifies CruiseControl_TestSuite.slreqx#29: Target speed will be limited between 20 and 90 mph
item 110 verifies CruiseControl_TestSuite.slreqx#19: Subsequent transition from disengaged (inactive) to engaged (active) with “Set Speed” input while enabled (on)
item 110 verifies CruiseControl_TestSuite.slreqx#20: Subsequent transition from disengaged (inactive) to engaged (active) with “Resume” input while enabled (on)
item 111 verifies CruiseControl_TestSuite.slreqx#28: Transition to disengaged (inactive) when vehicle speed is outside the limits of 20 to 90 mph
item 111 verifies CruiseControl_TestSuite.slreqx#29: Target speed will be limited between 20 and 90 mph
item 112 verifies CruiseControl_TestSuite.slreqx#21: “Accelerate” input increases target speed only when engaged (active)
item 113 verifies CruiseControl_TestSuite.slreqx#28: Transition to disengaged (inactive) when vehicle speed is outside the limits of 20 to 90 mph
item 113 verifies CruiseControl_TestSuite.slreqx#29: Target speed will be limited between 20 and 90 mph
item 114 verifies CruiseControl_TestSuite.slreqx#28: Transition to disengaged (inactive) when vehicle speed is outside the limits of 20 to 90 mph
item 114 verifies CruiseControl_TestSuite.slreqx#29: Target speed will be limited between 20 and 90 mph
item 115 verifies CruiseControl_TestSuite.slreqx#17: Initial transition from disengaged (inactive) to engaged (active) only with “Set Speed” input after enabling (on)
item 116 verifies CruiseControl_TestSuite.slreqx#23: Continuous “Accelerate” input increases target speed at a fixed rate and only when engaged (active)
item 117 verifies CruiseControl_TestSuite.slreqx#15: Not engaged with enabling (on)
item 118 verifies CruiseControl_TestSuite.slreqx#26: Vehicle braking will transition system to disengaged (inactive) when engaged (active)
item 118 verifies CruiseControl_TestSuite.slreqx#34: Disengage when braking occurs
item 119 verifies CruiseControl_TestSuite.slreqx#24: Continuous “Decelerate” input decreases target speed at a fixed rate and only when engaged (active)
item 120 verifies CruiseControl_TestSuite.slreqx#18: “Resume” input ignored until the initial transition from disengaged (inactive) to engaged (active)
item 121 verifies CruiseControl_TestSuite.slreqx#16: Disengaged (not active) when disabled (off)
item 122 verifies CruiseControl_TestSuite.slreqx#24: Continuous “Decelerate” input decreases target speed at a fixed rate and only when engaged (active)
item 123 verifies CruiseControl_TestSuite.slreqx#22: “Decelerate” input decreases target speed only when engaged (active)
item 124 verifies CruiseControl_TestSuite.slreqx#27: Transition to engaged (active) will only be permitted for vehicle speeds between 20 and 90 mph
item 124 verifies CruiseControl_TestSuite.slreqx#29: Target speed will be limited between 20 and 90 mph
item 125 verifies CruiseControl_TestSuite.slreqx#18: “Resume” input ignored until the initial transition from disengaged (inactive) to engaged (active)
item 126 verifies CruiseControl_TestSuite.slreqx#16: Disengaged (not active) when disabled (off)
item 127 verifies CruiseControl_TestSuite.slreqx#19: Subsequent transition from disengaged (inactive) to engaged (active) with “Set Speed” input while enabled (on)
item 127 verifies CruiseControl_TestSuite.slreqx#20: Subsequent transition from disengaged (inactive) to engaged (active) with “Resume” input while enabled (on)
item 128 verifies CruiseControl_TestSuite.slreqx#23: Continuous “Accelerate” input increases target speed at a fixed rate and only when engaged (active)
item 129 verifies CruiseControl_TestSuite.slreqx#15: Not engaged with enabling (on)
item 130 verifies CruiseControl_TestSuite.slreqx#22: “Decelerate” input decreases target speed only when engaged (active)
item 131 verifies CruiseControl_TestSuite.slreqx#15: Not engaged with enabling (on)
item 132 verifies CruiseControl_TestSuite.slreqx#22: “Decelerate” input decreases target speed only when engaged (active)
item 133 verifies CruiseControl_TestSuite.slreqx#28: Transition to disengaged (inactive) when vehicle speed is outside the limits of 20 to 90 mph
item 133 verifies CruiseControl_TestSuite.slreqx#29: Target speed will be limited between 20 and 90 mph
item 134 verifies CruiseControl_TestSuite.slreqx#19: Subsequent transition from disengaged (inactive) to engaged (active) with “Set Speed” input while enabled (on)
item 134 verifies CruiseControl_TestSuite.slreqx#20: Subsequent transition from disengaged (inactive) to engaged (active) with “Resume” input while enabled (on)
item 135 verifies CruiseControl_TestSuite.slreqx#24: Continuous “Decelerate” input decreases target speed at a fixed rate and only when engaged (active)
item 136 verifies CruiseControl_TestSuite.slreqx#21: “Accelerate” input increases target speed only when engaged (active)
item 137 verifies CruiseControl_TestSuite.slreqx#15: Not engaged with enabling (on)
item 138 verifies CruiseControl_TestSuite.slreqx#18: “Resume” input ignored until the initial transition from disengaged (inactive) to engaged (active)
item 139 verifies CruiseControl_TestSuite.slreqx#17: Initial transition from disengaged (inactive) to engaged (active) only with “Set Speed” input after enabling (on)
item 140 verifies CruiseControl_TestSuite.slreqx#16: Disengaged (not active) when disabled (off)
item 141 verifies CruiseControl_TestSuite.slreqx#15: Not engaged with enabling (on)
item 142 verifies CruiseControl_TestSuite.slreqx#27: Transition to engaged (active) will only be permitted for vehicle speeds between 20 and 90 mph
item 142 verifies CruiseControl_TestSuite.slreqx#29: Target speed will be limited between 20 and 90 mph
item 143 verifies CruiseControl_TestSuite.slreqx#26: Vehicle braking will transition system to disengaged (inactive) when engaged (active)
item 143 verifies CruiseControl_TestSuite.slreqx#34: Disengage when braking occurs
item 144 verifies CruiseControl_TestSuite.slreqx#19: Subsequent transition from disengaged (inactive) to engaged (active) with “Set Speed” input while enabled (on)
item 144 verifies CruiseControl_TestSuite.slreqx#20: Subsequent transition from disengaged (inactive) to engaged (active) with “Resume” input while enabled (on)
item 145 verifies CruiseControl_TestSuite.slreqx#17: Initial transition from disengaged (inactive) to engaged (active) only with “Set Speed” input after enabling (on)
item 146 verifies CruiseControl_TestSuite.slreqx#28: Transition to disengaged (inactive) when vehicle speed is outside the limits of 20 to 90 mph
item 146 verifies CruiseControl_TestSuite.slreqx#29: Target speed will be limited between 20 and 90 mph
item 147 verifies CruiseControl_TestSuite.slreqx#15: Not engaged with enabling (on)
item 148 verifies CruiseControl_TestSuite.slreqx#16: Disengaged (not active) when disabled (off)
item 149 verifies CruiseControl_TestSuite.slreqx#24: Continuous “Decelerate” input decreases target speed at a fixed rate and only when engaged (active)
item 150 verifies CruiseControl_TestSuite.slreqx#28: Transition to disengaged (inactive) when vehicle speed is outside the limits of 20 to 90 mph
item 150 verifies CruiseControl_TestSuite.slreqx#29: Target speed will be limited between 20 and 90 mph
item 151 verifies CruiseControl_TestSuite.slreqx#23: Continuous “Accelerate” input increases target speed at a fixed rate and only when engaged (active)
item 152 verifies CruiseControl_TestSuite.slreqx#28: Transition to disengaged (inactive) when vehicle speed is outside the limits of 20 to 90 mph
item 152 verifies CruiseControl_TestSuite.slreqx#29: Target speed will be limited between 20 and 90 mph
item 153 verifies CruiseControl_TestSuite.slreqx#14: Disabled (off) during start-up
item 154 verifies CruiseControl_TestSuite.slreqx#22: “Decelerate” input decreases target speed only when engaged (active)
item 155 verifies CruiseControl_TestSuite.slreqx#23: Continuous “Accelerate” input increases target speed at a fixed rate and only when engaged (active)
item 156 verifies CruiseControl_TestSuite.slreqx#24: Continuous “Decelerate” input decreases target speed at a fixed rate and only when engaged (active)
item 157 verifies CruiseControl_TestSuite.slreqx#18: “Resume” input ignored until the initial transition from disengaged (inactive) to engaged (active)
item 158 verifies CruiseControl_TestSuite.slreqx#22: “Decelerate” input decreases target speed only when engaged (active)
item 159 verifies CruiseControl_TestSuite.slreqx#28: Transition to disengaged (inactive) when vehicle speed is outside the limits of 20 to 90 mph
item 159 verifies CruiseControl_TestSuite.slreqx#29: Target speed will be limited between 20 and 90 mph
item 160 verifies CruiseControl_TestSuite.slreqx#19: Subsequent transition from disengaged (inactive) to engaged (active) with “Set Speed” input while enabled (on)
item 160 verifies CruiseControl_TestSuite.slreqx#20: Subsequent transition from disengaged (inactive) to engaged (active) with “Resume” input while enabled (on)
item 161 verifies CruiseControl_TestSuite.slreqx#23: Continuous “Accelerate” input increases target speed at a fixed rate and only when engaged (active)
item 162 verifies CruiseControl_TestSuite.slreqx#23: Continuous “Accelerate” input increases target speed at a fixed rate and only when engaged (active)
item 163 verifies CruiseControl_TestSuite.slreqx#17: Initial transition from disengaged (inactive) to engaged (active) only with “Set Speed” input after enabling (on)
item 164 verifies CruiseControl_TestSuite.slreqx#26: Vehicle braking will transition system to disengaged (inactive) when engaged (active)
item 164 verifies CruiseControl_TestSuite.slreqx#34: Disengage when braking occurs
item 165 verifies CruiseControl_TestSuite.slreqx#21: “Accelerate” input increases target speed only when engaged (active)
item 166 verifies CruiseControl_TestSuite.slreqx#16: Disengaged (not active) when disabled (off)
item 167 verifies CruiseControl_TestSuite.slreqx#15: Not engaged with enabling (on)
item 168 verifies CruiseControl_TestSuite.slreqx#17: Initial transition from disengaged (inactive) to engaged (active) only with “Set Speed” input after enabling (on)
item 169 verifies CruiseControl_TestSuite.slreqx#26: Vehicle braking will transition system to disengaged (inactive) when engaged (active)
item 169 verifies CruiseControl_TestSuite.slreqx#34: Disengage when braking occurs
item 170 verifies CruiseControl_TestSuite.slreqx#18: “Resume” input ignored until the initial transition from disengaged (inactive) to engaged (active)
item 171 verifies CruiseControl_TestSuite.slreqx#15: Not engaged with enabling (on)
item 172 verifies CruiseControl_TestSuite.slreqx#22: “Decelerate” input decreases target speed only when engaged (active)
item 173 verifies CruiseControl_TestSuite.slreqx#16: Disengaged (not active) when disabled (off)
item 174 verifies CruiseControl_TestSuite.slreqx#22: “Decelerate” input decreases target speed only when engaged (active)
item 175 verifies CruiseControl_TestSuite.slreqx#18: “Resume” input ignored until the initial transition from disengaged (inactive) to engaged (active)
item 176 verifies CruiseControl_TestSuite.slreqx#17: Initial transition from disengaged (inactive) to engaged (active) only with “Set Speed” input after enabling (on)
item 177 verifies CruiseControl_TestSuite.slreqx#19: Subsequent transition from disengaged (inactive) to engaged (active) with “Set Speed” input while enabled (on)
item 177 verifies CruiseControl_TestSuite.slreqx#20: Subsequent transition from disengaged (inactive) to engaged (active) with “Resume” input while enabled (on)
item 178 verifies CruiseControl_TestSuite.slreqx#14: Disabled (off) during start-up
item 179 verifies CruiseControl_TestSuite.slreqx#26: Vehicle braking will transition system to disengaged (inactive) when engaged (active)
item 179 verifies CruiseControl_TestSuite.slreqx#34: Disengage when braking occurs
item 180 verifies CruiseControl_TestSuite.slreqx#26: Vehicle braking will transition system to disengaged (inactive) when engaged (active)
item 180 verifies CruiseControl_TestSuite.slreqx#34: Disengage when braking occurs
item 181 verifies CruiseControl_TestSuite.slreqx#26: Vehicle braking will transition system to disengaged (inactive) when engaged (active)
item 181 verifies CruiseControl_TestSuite.slreqx#34: Disengage when braking occurs
item 182 verifies CruiseControl_TestSuite.slreqx#27: Transition to engaged (active) will only be permitted for vehicle speeds between 20 and 90 mph
item 182 verifies CruiseControl_TestSuite.slreqx#29: Target speed will be limited between 20 and 90 mph
item 183 verifies CruiseControl_TestSuite.slreqx#26: Vehicle braking will transition system to disengaged (inactive) when engaged (active)
item 183 verifies CruiseControl_TestSuite.slreqx#34: Disengage when braking occurs
item 184 verifies CruiseControl_TestSuite.slreqx#19: Subsequent transition from disengaged (inactive) to engaged (active) with “Set Speed” input while enabled (on)
item 184 verifies CruiseControl_TestSuite.slreqx#20: Subsequent transition from disengaged (inactive) to engaged (active) with “Resume” input while enabled (on)
item 185 verifies CruiseControl_TestSuite.slreqx#26: Vehicle braking will transition system to disengaged (inactive) when engaged (active)
item 185 verifies CruiseControl_TestSuite.slreqx#34: Disengage when braking occurs
item 186 verifies CruiseControl_TestSuite.slreqx#26: Vehicle braking will transition system to disengaged (inactive) when engaged (active)
item 186 verifies CruiseControl_TestSuite.slreqx#34: Disengage when braking occurs
item 187 verifies CruiseControl_TestSuite.slreqx#23: Continuous “Accelerate” input increases target speed at a fixed rate and only when engaged (active)
item 188 verifies CruiseControl_TestSuite.slreqx#24: Continuous “Decelerate” input decreases target speed at a fixed rate and only when engaged (active)
item 189 verifies CruiseControl_TestSuite.slreqx#15: Not engaged with enabling (on)
item 190 verifies CruiseControl_TestSuite.slreqx#26: Vehicle braking will transition system to disengaged (inactive) when engaged (active)
item 190 verifies CruiseControl_TestSuite.slreqx#34: Disengage when braking occurs
item 191 verifies CruiseControl_TestSuite.slreqx#15: Not engaged with enabling (on)
item 192 verifies CruiseControl_TestSuite.slreqx#22: “Decelerate” input decreases target speed only when engaged (active)
item 193 verifies CruiseControl_TestSuite.slreqx#16: Disengaged (not active) when disabled (off)
item 194 verifies CruiseControl_TestSuite.slreqx#14: Disabled (off) during start-up
item 195 verifies CruiseControl_TestSuite.slreqx#18: “Resume” input ignored until the initial transition from disengaged (inactive) to engaged (active)
item 196 verifies CruiseControl_TestSuite.slreqx#18: “Resume” input ignored until the initial transition from disengaged (inactive) to engaged (active)
item 197 verifies CruiseControl_TestSuite.slreqx#21: “Accelerate” input increases target speed only when engaged (active)
item 198 verifies CruiseControl_TestSuite.slreqx#14: Disabled (off) during start-up
item 199 verifies CruiseControl_TestSuite.slreqx#15: Not engaged with enabling (on)
item 200 verifies CruiseControl_TestSuite.slreqx#27: Transition to engaged (active) will only be permitted for vehicle speeds between 20 and 90 mph
item 200 verifies CruiseControl_TestSuite.slreqx#29: Target speed will be limited between 20 and 90 mph
item 201 verifies CruiseControl_TestSuite.slreqx#16: Disengaged (not active) when disabled (off)
item 202 verifies CruiseControl_TestSuite.slreqx#23: Continuous “Accelerate” input increases target speed at a fixed rate and only when engaged (active)
item 203 verifies CruiseControl_TestSuite.slreqx#21: “Accelerate” input increases target speed only when engaged (active)
item 204 verifies CruiseControl_TestSuite.slreqx#26: Vehicle braking will transition system to disengaged (inactive) when engaged (active)
item 204 verifies CruiseControl_TestSuite.slreqx#34: Disengage when braking occurs
item 205 verifies CruiseControl_TestSuite.slreqx#17: Initial transition from disengaged (inactive) to engaged (active) only with “Set Speed” input after enabling (on)
item 206 verifies CruiseControl_TestSuite.slreqx#18: “Resume” input ignored until the initial transition from disengaged (inactive) to engaged (active)
item 207 verifies CruiseControl_TestSuite.slreqx#16: Disengaged (not active) when disabled (off)
item 208 verifies CruiseControl_TestSuite.slreqx#23: Continuous “Accelerate” input increases target speed at a fixed rate and only when engaged (active)
item 209 verifies CruiseControl_TestSuite.slreqx#22: “Decelerate” input decreases target speed only when engaged (active)
item 210 verifies CruiseControl_TestSuite.slreqx#16: Disengaged (not active) when disabled (off)
item 211 verifies CruiseControl_TestSuite.slreqx#14: Disabled (off) during start-up
item 212 verifies CruiseControl_TestSuite.slreqx#24: Continuous “Decelerate” input decreases target speed at a fixed rate and only when engaged (active)
item 213 verifies CruiseControl_TestSuite.slreqx#16: Disengaged (not active) when disabled (off)
item 214 verifies CruiseControl_TestSuite.slreqx#19: Subsequent transition from disengaged (inactive) to engaged (active) with “Set Speed” input while enabled (on)
item 214 verifies CruiseControl_TestSuite.slreqx#20: Subsequent transition from disengaged (inactive) to engaged (active) with “Resume” input while enabled (on)
item 215 verifies CruiseControl_TestSuite.slreqx#18: “Resume” input ignored until the initial transition from disengaged (inactive) to engaged (active)
item 216 verifies CruiseControl_TestSuite.slreqx#15: Not engaged with enabling (on)
item 217 verifies CruiseControl_TestSuite.slreqx#19: Subsequent transition from disengaged (inactive) to engaged (active) with “Set Speed” input while enabled (on)
item 217 verifies CruiseControl_TestSuite.slreqx#20: Subsequent transition from disengaged (inactive) to engaged (active) with “Resume” input while enabled (on)
item 218 verifies CruiseControl_TestSuite.slreqx#23: Continuous “Accelerate” input increases target speed at a fixed rate and only when engaged (active)
item 219 verifies CruiseControl_TestSuite.slreqx#24: Continuous “Decelerate” input decreases target speed at a fixed rate and only when engaged (active)
item 220 verifies CruiseControl_TestSuite.slreqx#14: Disabled (off) during start-up
item 221 verifies CruiseControl_TestSuite.slreqx#22: “Decelerate” input decreases target speed only when engaged (active)
item 222 verifies CruiseControl_TestSuite.slreqx#15: Not engaged with enabling (on)
item 223 verifies CruiseControl_TestSuite.slreqx#21: “Accelerate” input increases target speed only when engaged (active)
item 224 verifies CruiseControl_TestSuite.slreqx#28: Transition to disengaged (inactive) when vehicle speed is outside the limits of 20 to 90 mph
item 224 verifies CruiseControl_TestSuite.slreqx#29: Target speed will be limited between 20 and 90 mph
item 225 verifies CruiseControl_TestSuite.slreqx#21: “Accelerate” input increases target speed only when engaged (active)
item 226 verifies CruiseControl_TestSuite.slreqx#19: Subsequent transition from disengaged (inactive) to engaged (active) with “Set Speed” input while enabled (on)
item 226 verifies CruiseControl_TestSuite.slreqx#20: Subsequent transition from disengaged (inactive) to engaged (active) with “Resume” input while enabled (on)
item 227 verifies CruiseControl_TestSuite.slreqx#16: Disengaged (not active) when disabled (off)
item 228 verifies CruiseControl_TestSuite.slreqx#15: Not engaged with enabling (on)
item 229 verifies CruiseControl_TestSuite.slreqx#15: Not engaged with enabling (on)
item 230 verifies CruiseControl_TestSuite.slreqx#18: “Resume” input ignored until the initial transition from disengaged (inactive) to engaged (active)
item 231 verifies CruiseControl_TestSuite.slreqx#18: “Resume” input ignored until the initial transition from disengaged (inactive) to engaged (active)
item 232 verifies CruiseControl_TestSuite.slreqx#19: Subsequent transition from disengaged (inactive) to engaged (active) with “Set Speed” input while enabled (on)
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